# Grasshopper definition parabolicAngularTrussSystem_Tekla.gh (Grasshopper 1.0.7)
# plug-ins: Grasshopper-Tekla Link 2019i.1.6, AxisVM, LunchBox

# ----
# Bemenő adatok
# Keretállások
tartó_magasság = Slider(1, range=0..1)
belső_fesztávolság = Slider(43.4, range=40..46)
szegmensek_száma = Slider(40, range=0..100)
keretállás_távolság = Slider(10, range=5..12)
belső_magasság = Slider(13, range=12..21)
keretállások_száma = Slider(12, range=2..20)

# ----
# Szelemenek
szelemen_szegmensek_száma = Slider(6, range=4..12)
szelemen_az_ív_közepén = ValueList({"Van": True, "Nincs": False}, selected="Van")
szelemenek_elosztása = ValueList({"Minden csomópontban": 1, "Minden második csomópontban": 2, "Minden negyedik csomópontban": 4}, selected="Minden negyedik csomópontban")

# ----
# Merevítés
_3_merevítés_pozíciója = Slider(10, range=0..10)
_4_merevítés_pozíciója = Slider(7, range=0..9)
list = ValueList({"Szimpa merevítés 1": 0, "Szimpa merevítés 1": 1, "X\" merevítés": 2}, selected="X\" merevítés")
merevítések_száma = Slider(3, range=1..4)
_1_merevítés_pozíciója = Slider(5, range=0..9)
_2_merevítés_pozíciója = Slider(0, range=0..9)

# ---- group: Vonalvezetés
division = Division(A=belső_fesztávolság, B="2")
panel = Panel(division)
panel_2 = Panel(division)
dom = ConstructDomain(DomainStart=expr("-x", panel), DomainEnd=panel_2)
dom_2 = ConstructDomain(DomainStart="0", DomainEnd="1")
range = Range(Domain=dom, Steps=Slider(38, range=0..100))
remap = RemapNumbers(Value=range, Source=dom, Target=dom_2)  # -> Mapped, Clipped
graph = GraphMapper(remap.Mapped, x0=0, x1=1, y0=0, y1=1, Ox=0.5, Oy=1, Px=1, Py=0, container_name="Parabola")
panel_3 = Panel(belső_magasság)
multiplication = Multiplication(A=graph, B=panel_3)
multiplication_2 = Multiplication(A=tartó_magasság, B=-1)
pt = ConstructPoint(XCoordinate=range, YCoordinate=0, ZCoordinate=multiplication)
intcrv = Interpolate(Vertices=pt, Degree=3, Periodic=False, KnotStyle=1)  # -> Curve, Length, Domain
offset = OffsetCurve(Curve=intcrv.Curve, Distance=[tartó_magasság, multiplication_2], Plane=PlaneXY(0, 0, 0), Corners=1)  # -> flatten(Curve)
len = Length(Curve=offset)
sort = SortList(Keys=len, ValuesA=offset)  # -> Keys, ValuesA
item = ListItem(List=sort.ValuesA, Index=expr("-1", 0), Wrap=True)

# ----
# Űrszelvény
xz = XZPlane(Origin=Point(0, 0, 0))
rectangle = Rectangle(Plane=xz, XSize="31", YSize="6.2", Radius=0)  # -> Rectangle, Length
division_2 = Division(A="31", B="-2")
X = UnitX(Factor=division_2)
move = Move(Geometry=rectangle.Rectangle, Motion=X)  # -> Geometry, Transform
subtraction = Subtraction(A=keretállások_száma, B="1")
multiplication_3 = Multiplication(A=keretállás_távolság, B=subtraction)
Y = UnitY(Factor=multiplication_3)
move_2 = Move(Geometry=move.Geometry, Motion=Y)  # -> Geometry, Transform
loft = Loft(
    Curves=[move.Geometry, move_2.Geometry],
    Options={Adjust=False, Closed=False, LoftEnds=0, LoftSimp=0, LoftType=0, Rebuild=10, Refit=0.01})
cap = CapHoles(Brep=loft)

# ----
# Egy keretállás
number_slider = Slider(0, range=0..2)
truss = _2DTruss(CurveA=intcrv.Curve, CurveB=item, Divisions=szegmensek_száma, TrussToggle=number_slider)  # -> PrimaryLines, BraceLines, VerticalLines, StructureNodes
dispatch = Dispatch(List=truss.PrimaryLines, DispatchPattern=[False, True])  # -> ListA, ListB
dispatch_2 = Dispatch(List=truss.StructureNodes, DispatchPattern=[False, True])  # -> ListA, ListB
ferde_rácsrudak = Line(truss.BraceLines)
normál_irányú_rácsrudak = Line(truss.VerticalLines)
felső_öv = Line(dispatch.ListA)
felső_csp = Point(dispatch_2.ListA)
series = Series(Start=0, Step=-1, Count=2)
series_2 = Series(Start=0, Step=-1, Count=2)
series_3 = Series(Start=0, Step=-1, Count=2)
series_4 = Series(Start=0, Step=-1, Count=2)
cull_i = CullIndex(List=ferde_rácsrudak, Indices=series_3, Wrap=True)
item_2 = ListItem(List=ferde_rácsrudak, Index=series_3, Wrap=True)
cull_i_2 = CullIndex(List=normál_irányú_rácsrudak, Indices=series, Wrap=True)
item_3 = ListItem(List=normál_irányú_rácsrudak, Index=series, Wrap=True)
cull_i_3 = CullIndex(List=felső_csp, Indices=series_2, Wrap=True)
item_4 = ListItem(List=felső_csp, Index=series_2, Wrap=True)
item_5 = ListItem(List=felső_öv, Index=series_4, Wrap=True)
cull_i_4 = CullIndex(List=felső_öv, Indices=series_4, Wrap=True)
lng = ListLength(List=felső_öv)  # -> expr("x-1", Length)
alsó_csp = Point(dispatch_2.ListB)
series_5 = Series(Start=0, Step=lng, Count=2)
series_6 = Series(Start=0, Step=-1, Count=2)
replace = ReplaceItems(List=felső_öv, Item=item_2, Indices=series_5, Wrap=False)
alsó_közép_csp = CullIndex(List=alsó_csp, Indices=series_6, Wrap=True)
alsó_szélső_csp = ListItem(List=alsó_csp, Index=series_6, Wrap=True)
alsó_öv = Line(dispatch.ListB)
ferde_rácsrudak_2 = Line(cull_i)
felső_csp_2 = Point(cull_i_3)
alsó_közép_csp_2 = Point(alsó_közép_csp)
alsó_szélső_csp_2 = Point(alsó_szélső_csp)
felső_öv_2 = Line(replace)
normál_irányú_rácsrudak_2 = Line(cull_i_2)

# ----
# Keretállások
series_7 = Series(Start=0, Step=keretállás_távolság, Count=keretállások_száma)
Y_2 = UnitY(Factor=series_7)
flip = FlipMatrix(Data=felső_öv_2)
flip_2 = FlipMatrix(Data=alsó_öv)
flip_3 = FlipMatrix(Data=ferde_rácsrudak_2)
flip_4 = FlipMatrix(Data=normál_irányú_rácsrudak_2)
flip_5 = FlipMatrix(Data=felső_csp_2)
flip_6 = FlipMatrix(Data=alsó_közép_csp_2)
flip_7 = FlipMatrix(Data=alsó_szélső_csp_2)
move_3 = Move(Geometry=flip, Motion=Y_2)  # -> simplify(Geometry), Transform
move_4 = Move(Geometry=flip_2, Motion=Y_2)  # -> simplify(Geometry), Transform
move_5 = Move(Geometry=flip_3, Motion=Y_2)  # -> simplify(Geometry), Transform
move_6 = Move(Geometry=flip_4, Motion=Y_2)  # -> simplify(Geometry), Transform
move_7 = Move(Geometry=flip_5, Motion=Y_2)  # -> simplify(Geometry), Transform
move_8 = Move(Geometry=flip_6, Motion=Y_2)  # -> simplify(Geometry), Transform
move_9 = Move(Geometry=flip_7, Motion=Y_2)  # -> simplify(Geometry), Transform
flip_8 = FlipMatrix(Data=move_3.Geometry)
flip_9 = FlipMatrix(Data=move_4.Geometry)
flip_10 = FlipMatrix(Data=move_5.Geometry)
flip_11 = FlipMatrix(Data=move_6.Geometry)
flip_12 = FlipMatrix(Data=move_7.Geometry)
flip_13 = FlipMatrix(Data=move_8.Geometry)
flip_14 = FlipMatrix(Data=move_9.Geometry)

# ---- group: Rácsos szelemenek
# Szelemenek
series_8 = Series(Start=0, Step=1, Count=expr("x-1", keretállások_száma))  # -> simplify(graft(Series))
addition = Addition(A=series_8, B=1)
series_9 = Series(Start=0, Step=1, Count=expr("x-1", szegmensek_száma))
item_6 = TreeItem(Tree=flip_12, Path=series_8, Index=series_9, Wrap=True)
item_7 = TreeItem(Tree=flip_12, Path=addition, Index=series_9, Wrap=True)
item_8 = TreeItem(Tree=flip_13, Path=series_8, Index=series_9, Wrap=True)
item_9 = TreeItem(Tree=flip_13, Path=addition, Index=series_9, Wrap=True)
szelemen_felső_alkotók = Line(StartPoint=item_6, EndPoint=item_7)  # -> simplify(Line)
szelemen_alsó_alkotók = Line(StartPoint=item_8, EndPoint=item_9)  # -> simplify(Line)
keretállások_száma_2 = Integer(szegmensek_száma)
panel_4 = Panel(szelemenek_elosztása)
division_3 = Division(A=szegmensek_száma, B=2)
középső_szelemen = Panel(szelemen_az_ív_közepén)
division_4 = Division(A=keretállások_száma_2, B=panel_4)
subtraction_2 = Subtraction(A=division_3, B=1)
series_10 = Series(Start=Slider(0, range=0..10), Step=panel_4, Count=expr("(x-1)/2", division_4))
cull = CullPattern(List=subtraction_2, CullPattern=középső_szelemen)
addition_2 = Addition(A=series_10, B=1)
multiplication_4 = Multiplication(A=addition_2, B=-1)  # -> reverse(Result)
entwine = Entwine(Branch00=series_10, Branch01=cull, Branch02=multiplication_4, FlattenInputs=True)  # -> flatten(Result)
item_10 = ListItem(List=szelemen_alsó_alkotók, Index=entwine, Wrap=True)
item_11 = ListItem(List=szelemen_felső_alkotók, Index=entwine, Wrap=True)
panel_5 = Panel(szelemen_szegmensek_száma)
truss_2 = _2DTruss(CurveA=item_11, CurveB=item_10, Divisions=panel_5, TrussToggle=0)  # -> PrimaryLines, BraceLines, VerticalLines, StructureNodes
series_11 = Series(Start=0, Step=-1, Count=2)
cull_i_5 = CullIndex(List=truss_2.VerticalLines, Indices=series_11, Wrap=True)
item_12 = ListItem(List=truss_2.VerticalLines, Index=series_11, Wrap=True)
szelemen_függőleges_rácsrudak = Line(simplify(cull_i_5))
szelemen_ferde_rácsrudak = Line(truss_2.BraceLines)
szelemen_övek = Line(truss_2.PrimaryLines)

# ----
# Merevítések
panel_6 = Panel(_1_merevítés_pozíciója)
panel_7 = Panel(_4_merevítés_pozíciója)
panel_8 = Panel(list)
panel_9 = Panel(_2_merevítés_pozíciója)
panel_10 = Panel(_3_merevítés_pozíciója)
panel_11 = Panel(merevítések_száma)
series_12 = Series(Start=0, Step=1, Count=panel_11)
merge = Merge(Data1=panel_6, Data2=panel_9, Data3=panel_10, Data4=panel_7)
lng_2 = ListLength(List=entwine)
series_13 = Series(Start=0, Step=1, Count=lng_2)
item_13 = ListItem(List=merge, Index=series_12, Wrap=True)  # -> graft(Item)
end = EndPoints(Curve=item_11)  # -> Start, End
item_14 = TreeItem(Tree=end.End, Path=item_13, Index=series_13, Wrap=True)  # -> simplify(Element)
item_15 = TreeItem(Tree=end.Start, Path=item_13, Index=series_13, Wrap=True)  # -> simplify(Element)
shift = ShiftList(List=item_15, Shift=1, Wrap=True)
shift_2 = ShiftList(List=item_14, Shift=1, Wrap=True)
ln = Line(StartPoint=item_14, EndPoint=shift)
ln_2 = Line(StartPoint=item_15, EndPoint=shift_2)
cull_i_6 = CullIndex(List=ln, Indices="-1", Wrap=True)
cull_i_7 = CullIndex(List=ln_2, Indices="-1", Wrap=True)
dispatch_3 = Dispatch(List=cull_i_6, DispatchPattern=[True, False])  # -> ListA, ListB
dispatch_4 = Dispatch(List=cull_i_7, DispatchPattern=[True, False])  # -> ListA, ListB
line = Line(dispatch_4.ListA)
line_2 = Line(dispatch_4.ListB)
line_3 = Line(dispatch_3.ListA)
line_4 = Line(dispatch_3.ListB)
line_5 = Line(simplify([line, line_4]))
line_6 = Line(simplify([line_2, line_3]))
line_7 = Line(simplify([line, line_2, line_3, line_4]))
entwine_2 = Entwine(Branch00=line_5, Branch01=line_6, Branch02=line_7, FlattenInputs=True)  # -> simplify(Result)
branch = TreeBranch(Tree=entwine_2, Path=panel_8, MaintainPaths=True)

# ----
# Szelemenek felső övelforgatásának szöge
item_16 = ListItem(List=szelemen_felső_alkotók, Index=entwine, Wrap=True)
lng_3 = ListLength(List=entwine)
crv = Curve(item)
series_14 = Series(Start=0, Step=1, Count=lng_3)
item_17 = TreeItem(Tree=item_16, Path="0", Index=series_14, Wrap=True)
end_2 = EndPoints(Curve=item_17)  # -> Start, End
crv_cp = CurveClosestPoint(Point=end_2.Start, Curve=crv)  # -> Point, Parameter, Distance
pframe = PerpFrame(Curve=crv, Parameter=crv_cp.Parameter)
deplane = DeconstructPlane(Plane=pframe)  # -> Origin, XAxis, YAxis, ZAxis
line_8 = LineSDL(Start=deplane.Origin, Direction=deplane.XAxis, Length=Slider(4, range=0..10))
xz_2 = XZPlane(Origin=Point(0, 0, 0))
end_3 = EndPoints(Curve=line_8)  # -> Start, End
X_2 = UnitX(Factor=1)
line_9 = LineSDL(Start=end_3.End, Direction=X_2, Length=1)
angle = Angle(VectorA=line_8, VectorB=line_9, Plane=xz_2)  # -> Angle, Reflex
deg = Degrees(Radians=angle.Angle)
expression = Expression(x=deg, Expression="(round(x * 100) / 100)")
points = PointList(Points=end_3.Start, Size=Slider(2, range=0..10))
expression_2 = Expression(x=expression, Expression="If(x≤90, x, x-180)")
panel_12 = Panel(expression_2)
panel_13 = Panel(expression)

# ----
# Szelemenek alsó övelforgatásának szöge
lng_4 = ListLength(List=entwine)
crv_2 = Curve(intcrv.Curve)
item_18 = ListItem(List=szelemen_alsó_alkotók, Index=entwine, Wrap=True)
series_15 = Series(Start=0, Step=1, Count=lng_4)
item_19 = TreeItem(Tree=item_18, Path="0", Index=series_15, Wrap=True)
end_4 = EndPoints(Curve=item_19)  # -> Start, End
crv_cp_2 = CurveClosestPoint(Point=end_4.Start, Curve=crv_2)  # -> Point, Parameter, Distance
pframe_2 = PerpFrame(Curve=crv_2, Parameter=crv_cp_2.Parameter)
deplane_2 = DeconstructPlane(Plane=pframe_2)  # -> Origin, XAxis, YAxis, ZAxis
line_10 = LineSDL(Start=deplane_2.Origin, Direction=deplane_2.XAxis, Length=Slider(4, range=0..10))
xz_3 = XZPlane(Origin=Point(0, 0, 0))
end_5 = EndPoints(Curve=line_10)  # -> Start, End
X_3 = UnitX(Factor=1)
line_11 = LineSDL(Start=end_5.End, Direction=X_3, Length=1)
angle_2 = Angle(VectorA=line_10, VectorB=line_11, Plane=xz_3)  # -> Angle, Reflex
deg_2 = Degrees(Radians=angle_2.Angle)
expression_3 = Expression(x=deg_2, Expression="(round(x * 100) / 100)")
points_2 = PointList(Points=end_5.Start, Size=Slider(2, range=0..10))
expression_4 = Expression(x=expression_3, Expression="If(x≤90, x, x-180)")
panel_14 = Panel(expression_4)
panel_15 = Panel(expression_3)

# ----
# Keret alsó övek szögletesítése
number_slider_2 = Slider(10, range=0..10)
multiplication_5 = Multiplication(A=number_slider_2, B=-1)
entwine_3 = Entwine(Branch00=number_slider_2, Branch01=multiplication_5, FlattenInputs=True)
line_12 = LineSDL(Start=deplane_2.Origin, Direction=deplane_2.ZAxis, Length=entwine_3)  # -> simplify(Line)
path = ConstructPath(Indices="0")
path_2 = ConstructPath(Indices="1")
branch_2 = TreeBranch(Tree=line_12, Path=path, MaintainPaths=True)
branch_3 = TreeBranch(Tree=line_12, Path=path_2, MaintainPaths=True)
lng_5 = ListLength(List=branch_3)
series_16 = Series(Start=0, Step=1, Count=lng_5)
item_20 = ListItem(List=branch_2, Index=series_16, Wrap=True)
item_21 = ListItem(List=branch_3, Index=series_16, Wrap=True)
join = JoinCurves(Curves=[item_20, item_21], Preserve=False)
lng_6 = ListLength(List=join)
series_17 = Series(Start=0, Step=1, Count=expr("x-1", lng_6))
series_18 = Series(Start=1, Step=1, Count=expr("x-1", lng_6))
item_22 = ListItem(List=join, Index=series_17, Wrap=True)
item_23 = ListItem(List=join, Index=series_18, Wrap=True)
llx = LineLine(Line1=item_22, Line2=item_23)  # -> ParamA, ParamB, PointA, PointB
item_24 = ListItem(List=deplane_2.Origin, Index=-1, Wrap=True)
item_25 = ListItem(List=deplane_2.Origin, Index=0, Wrap=True)
entwine_4 = Entwine(Branch00=item_25, Branch01=llx.PointA, Branch02=item_24, FlattenInputs=True)  # -> flatten(Result)
crv_3 = Curve(intcrv.Curve)
lng_7 = ListLength(List=entwine_4)
end_6 = EndPoints(Curve=crv_3)  # -> Start, End
series_19 = Series(Start=0, Step=1, Count=expr("x-1", lng_7))
series_20 = Series(Start=1, Step=1, Count=expr("x-1", lng_7))
dist = Distance(PointA=item_25, PointB=end_6.Start)
item_26 = ListItem(List=entwine_4, Index=series_19, Wrap=True)
item_27 = ListItem(List=entwine_4, Index=series_20, Wrap=True)
ln_3 = Line(StartPoint=item_26, EndPoint=item_27)
item_28 = ListItem(List=ln_3, Index=expr("-1", 0), Wrap=True)
item_29 = ListItem(List=ln_3, Index=expr("0", 0), Wrap=True)
ext = ExtendCurve(Curve=item_28, Type=0, Start="0", End=dist)
ext_2 = ExtendCurve(Curve=item_29, Type=0, Start=dist, End="0")
lng_8 = ListLength(List=ln_3)
series_21 = Series(Start=0, Step=expr("x-1", lng_8), Count=2)
replace_2 = ReplaceItems(List=ln_3, Item=[ext_2, ext], Indices=series_21, Wrap=False)

# ----
# Keret felső övek szögletesítése
number_slider_3 = Slider(10, range=0..10)
multiplication_6 = Multiplication(A=number_slider_3, B=-1)
entwine_5 = Entwine(Branch00=number_slider_3, Branch01=multiplication_6, FlattenInputs=True)
line_13 = LineSDL(Start=deplane.Origin, Direction=deplane.ZAxis, Length=entwine_5)  # -> simplify(Line)
path_3 = ConstructPath(Indices="0")
path_4 = ConstructPath(Indices="1")
branch_4 = TreeBranch(Tree=line_13, Path=path_3, MaintainPaths=True)
branch_5 = TreeBranch(Tree=line_13, Path=path_4, MaintainPaths=True)
lng_9 = ListLength(List=branch_5)
series_22 = Series(Start=0, Step=1, Count=lng_9)
item_30 = ListItem(List=branch_4, Index=series_22, Wrap=True)
item_31 = ListItem(List=branch_5, Index=series_22, Wrap=True)
join_2 = JoinCurves(Curves=[item_30, item_31], Preserve=False)
lng_10 = ListLength(List=join_2)
series_23 = Series(Start=0, Step=1, Count=expr("x-1", lng_10))
series_24 = Series(Start=1, Step=1, Count=expr("x-1", lng_10))
item_32 = ListItem(List=join_2, Index=series_23, Wrap=True)
item_33 = ListItem(List=join_2, Index=series_24, Wrap=True)
llx_2 = LineLine(Line1=item_32, Line2=item_33)  # -> ParamA, ParamB, PointA, PointB
item_34 = ListItem(List=deplane.Origin, Index=-1, Wrap=True)
item_35 = ListItem(List=deplane.Origin, Index=0, Wrap=True)
entwine_6 = Entwine(Branch00=item_35, Branch01=llx_2.PointA, Branch02=item_34, FlattenInputs=True)  # -> flatten(Result)
crv_4 = Curve(item)
lng_11 = ListLength(List=entwine_6)
end_7 = EndPoints(Curve=crv_4)  # -> Start, End
series_25 = Series(Start=0, Step=1, Count=expr("x-1", lng_11))
series_26 = Series(Start=1, Step=1, Count=expr("x-1", lng_11))
dist_2 = Distance(PointA=item_35, PointB=end_7.Start)
item_36 = ListItem(List=entwine_6, Index=series_25, Wrap=True)
item_37 = ListItem(List=entwine_6, Index=series_26, Wrap=True)
ln_4 = Line(StartPoint=item_36, EndPoint=item_37)
item_38 = ListItem(List=ln_4, Index=expr("-1", 0), Wrap=True)
item_39 = ListItem(List=ln_4, Index=expr("0", 0), Wrap=True)
ext_3 = ExtendCurve(Curve=item_38, Type=0, Start="0", End=dist_2)
ext_4 = ExtendCurve(Curve=item_39, Type=0, Start=dist_2, End="0")
lng_12 = ListLength(List=ln_4)
series_27 = Series(Start=0, Step=expr("x-1", lng_12), Count=2)
replace_3 = ReplaceItems(List=ln_4, Item=[ext_4, ext_3], Indices=series_27, Wrap=False)

# ----
# Teljes szerkezet
alsó_öv_2 = Line(move_4.Geometry)
ferde_rácsrudak_3 = Line(move_5.Geometry)
merevítés = Line(branch)
felső_öv_3 = Line(move_3.Geometry)
normál_irányú_rácsrudak_3 = Line(move_6.Geometry)
szelemen_övek_2 = Line(szelemen_övek)
szelemen_ferde_rácsrudak_2 = Line(szelemen_ferde_rácsrudak)
szelemen_normál_irányú_rácsrudak = Line(szelemen_függőleges_rácsrudak)
övek = Merge(Data1=felső_öv_3, Data2=alsó_öv_2)  # -> flatten(Result)

# ----
# Mennyiségek tömegpontok értékeinek számításához
szelemen_övek_hossza = Integer(expr("x*2", keretállás_távolság))
szelemen_normál_rácsrudak = Line(szelemen_függőleges_rácsrudak)
szelemen_ferde_rácsrudak_3 = Line(szelemen_ferde_rácsrudak)
keret_ferde_rácsrudak = Line(ferde_rácsrudak_2)
keret_normál_rácsrudak = Line(normál_irányú_rácsrudak_2)
felső_öv_4 = Line(felső_öv_2)
alsó_öv_3 = Line(alsó_öv)
merevítések = Line(branch)
len_2 = Length(Curve=flatten(szelemen_ferde_rácsrudak_3))
len_3 = Length(Curve=flatten(szelemen_normál_rácsrudak))
len_4 = Length(Curve=keret_ferde_rácsrudak)
len_5 = Length(Curve=keret_normál_rácsrudak)
len_6 = Length(Curve=felső_öv_4)
len_7 = Length(Curve=alsó_öv_3)
len_8 = Length(Curve=merevítések)
subtraction_3 = Subtraction(A=keretállások_száma, B=1)
ma = MassAddition(Input=len_4)  # -> Result, PartialResults
lng_13 = ListLength(List=len_4)
lng_14 = ListLength(List=keret_ferde_rácsrudak)
ma_2 = MassAddition(Input=len_5)  # -> Result, PartialResults
lng_15 = ListLength(List=len_5)
lng_16 = ListLength(List=keret_normál_rácsrudak)
ma_3 = MassAddition(Input=len_6)  # -> Result, PartialResults
ma_4 = MassAddition(Input=len_7)  # -> Result, PartialResults
ma_5 = MassAddition(Input=len_8)  # -> Result, PartialResults
ma_6 = MassAddition(Input=len_2)  # -> Result, PartialResults
lng_17 = ListLength(List=len_2)
ma_7 = MassAddition(Input=len_3)  # -> Result, PartialResults
lng_18 = ListLength(List=len_3)
lng_19 = ListLength(List=entwine)
keretállás_távolság_2 = Integer(keretállás_távolság)
keretállások_száma_3 = Integer(keretállások_száma)
szelemen_szegmensek_száma_2 = Integer(szelemen_szegmensek_száma)
branch_6 = TreeBranch(Tree=flip_8, Path=subtraction_3, MaintainPaths=True)  # -> flatten(Branch)
division_5 = Division(A=ma.Result, B=lng_13)
division_6 = Division(A=ma_2.Result, B=lng_15)
division_7 = Division(A=ma_6.Result, B=lng_17)
division_8 = Division(A=ma_7.Result, B=lng_18)
join_3 = JoinCurves(Curves=felső_öv_2, Preserve=False)
join_4 = JoinCurves(Curves=branch_6, Preserve=False)
subtraction_4 = Subtraction(A=szelemen_szegmensek_száma_2, B=1)
ferde_rácsrudak_átlagos_hossza = Panel(division_5)
normál_rácsrudak_átlagos_hossza = Panel(division_6)
normál_rácsrudak_száma = Panel(lng_16)
keretállás_távolság_3 = Panel(keretállás_távolság_2)
keretállások_száma_4 = Panel(keretállások_száma_3)
szelemen_szegmensek_száma_3 = Panel(szelemen_szegmensek_száma_2)
szelemenek_száma = Panel(lng_19)
ferde_rácsrudak_száma = Panel(lng_14)
felső_öv_hossza = Panel(ma_3.Result)
alsó_öv_hossza = Panel(ma_4.Result)
szelemen_alsó_felső_övhossza = Panel(szelemen_övek_hossza)
multiplication_7 = Multiplication(A=division_7, B=szelemen_szegmensek_száma_2)
multiplication_8 = Multiplication(A=division_8, B=subtraction_4)
rulesrf = RuledSurface(CurveA=join_3, CurveB=join_4)
addition_3 = Addition(A=felső_öv_hossza, B=alsó_öv_hossza)
szelemen_ferde_rácsrudak_átlagos_hossza = Panel(multiplication_7)  # "Szelemen ferde rácsrudak átlagos hossza (szelemenenként)"
szelemen_normál_rácsrudak_átlagos_hossza = Panel(multiplication_8)  # "Szelemen normál rácsrudak átlagos hossza (szelemenenként)"
area = Area(Geometry=rulesrf)  # -> Area, Centroid
subtraction_5 = Subtraction(A=szelemenek_száma, B=1)
ferde_rácsrudak_átl_száma_2_szelemen_köz = Division(A=ferde_rácsrudak_száma, B=subtraction_5)  # "Ferde rácsrudak átl. száma 2 szelemen közt"
normál_rácsrudak_átl_száma_2_szelemen_kö = Division(A=normál_rácsrudak_száma, B=subtraction_5)  # "Normál rácsrudak átl. száma 2 szelemen közt"
normál_rácsrudak_átl_száma_2_szelemen_kö_2 = Division(A=addition_3, B=subtraction_5)  # "Normál rácsrudak átl. száma 2 szelemen közt"
szelemenek_közti_szegmensek_száma = Panel(subtraction_5)
lefedés_területe = Panel(area.Area)
multiplication_9 = Multiplication(A=ferde_rácsrudak_átlagos_hossza, B=ferde_rácsrudak_átl_száma_2_szelemen_köz)
multiplication_10 = Multiplication(A=normál_rácsrudak_átlagos_hossza, B=normál_rácsrudak_átl_száma_2_szelemen_kö)
_2_szelemen_közé_eső_ferde_rácsrudak_átl = Panel(multiplication_9)  # "2 szelemen közé eső ferde rácsrudak átl. szum. hossza"
_2_szelemen_közé_eső_normál_rácsrudak_át = Panel(multiplication_10)  # "2 szelemen közé eső normál rácsrudak átl. szum. hossza"
_2_szelemen_közé_eső_övek_szum_hossza = Panel(normál_rácsrudak_átl_száma_2_szelemen_kö_2)
merevítések_össz_hossza = Panel(ma_5.Result)
entwine_7 = Entwine(
    Branch00=_2_szelemen_közé_eső_ferde_rácsrudak_átl,
    Branch01=_2_szelemen_közé_eső_normál_rácsrudak_át,
    Branch02=_2_szelemen_közé_eső_övek_szum_hossza,
    Branch03=merevítések_össz_hossza,
    Branch04=szelemen_alsó_felső_övhossza,
    Branch05=szelemen_ferde_rácsrudak_átlagos_hossza,
    Branch06=szelemen_normál_rácsrudak_átlagos_hossza,
    Branch07=keretállás_távolság_3,
    Branch08=keretállások_száma_4,
    Branch09=szelemen_szegmensek_száma_3,
    Branch010=szelemenek_száma,
    Branch011=lefedés_területe,
    FlattenInputs=True)  # -> flatten(Result)
d_stbedudrive_onedrive_budapesti_műszaki = FilePath("D:\stbedudrive\OneDrive - Budapesti Műszaki és Gazdaságtudományi Egyetem\Egyetem\14_szakdolgozat\Grasshopper\reakcioerok.xlsx")  # "d:\stbedudrive\OneDrive - Budapesti Műszaki és Gazdaságtudományi Egyetem\Egyetem\14_szakdolgozat\Grasshopper\reakcioerokasd.xlsx"
excelwrite = ExcelWrite(
    WriteExcelData=Button(),
    WorkbookPath=d_stbedudrive_onedrive_budapesti_műszaki,
    WorksheetName="Munka1",
    ColumnHeadings="Grasshopper adatok",
    Data=entwine_7,
    ClearSheet=False)

# ----
# Exportálás Axisba
panel_16 = Panel("S 235")
axmembers = AxMembersAxisVM(Line=övek, Name="Övek", Mat="S 235", CrossSection="250X100X 6,0", Type="beam")  # -> flatten(AxMember)
axmembers_2 = AxMembersAxisVM(Line=ferde_rácsrudak_3, Name="Ferde rácsrudak", Mat=panel_16, CrossSection="50X 30X 3,0", Type="truss")  # -> flatten(AxMember)
axmembers_3 = AxMembersAxisVM(Line=normál_irányú_rácsrudak_3, Name="Normál irányú rácsrudak", Mat="S 235", CrossSection="50X 30X 4,0", Type="truss")  # -> flatten(AxMember)
axmembers_4 = AxMembersAxisVM(Line=szelemen_övek_2, Name="Szelemen övek", Mat="S 235", CrossSection="80X 40X 4,0", Type="beam")  # -> flatten(AxMember)
axmembers_5 = AxMembersAxisVM(Line=szelemen_ferde_rácsrudak_2, Name="Szelemen ferde rácsrudak", Mat="S 235", CrossSection="50X 30X 2,5", Type="truss")  # -> flatten(AxMember)
axmembers_6 = AxMembersAxisVM(
    Line=szelemen_normál_irányú_rácsrudak,
    Name="Szelemen normál irányú rácsrudak",
    Mat="S 235",
    CrossSection="50X 30X 3,2",
    Type="truss")  # -> flatten(AxMember)
axmembers_7 = AxMembersAxisVM(Line=merevítés, Name="Merevítés", Mat="S 235", CrossSection="O 40", Type="truss")  # -> flatten(AxMember)
entwine_8 = Entwine(
    Branch00=axmembers,
    Branch01=axmembers_2,
    Branch02=axmembers_3,
    Branch03=axmembers_4,
    Branch04=[axmembers_5, axmembers_6],
    Branch05=axmembers_7,
    FlattenInputs=True)  # -> flatten(Result)
axmember = AxMemberParameter(entwine_8)
membtoaxisvm = SendMembersToAxisVM(AxisVMMember=axmember)

# ----
# Szögletes keretek
lng_20 = ListLength(List=replace_3)
series_28 = Series(Start=0, Step=1, Count=lng_20)
item_40 = ListItem(List=replace_3, Index=series_28, Wrap=True)
item_41 = ListItem(List=replace_2, Index=series_28, Wrap=True)
truss_3 = _2DTruss(CurveA=item_41, CurveB=item_40, Divisions=Slider(4, range=0..10), TrussToggle=0)  # -> simplify(PrimaryLines), simplify(BraceLines), simplify(VerticalLines), StructureNodes
tstat = TreeStatistics(Tree=truss_3.PrimaryLines)  # -> Paths, Length, Count
tstat_2 = TreeStatistics(Tree=truss_3.VerticalLines)  # -> Paths, Length, Count
tstat_3 = TreeStatistics(Tree=truss_3.BraceLines)  # -> Paths, Length, Count
subtraction_6 = Subtraction(A=tstat.Count, B=1)
subtraction_7 = Subtraction(A=tstat_2.Count, B=1)
series_29 = Series(Start=0, Step=1, Count=subtraction_7)
subtraction_8 = Subtraction(A=tstat_3.Count, B=1)
branch_7 = TreeBranch(Tree=truss_3.PrimaryLines, Path=subtraction_6, MaintainPaths=True)
branch_8 = TreeBranch(Tree=truss_3.PrimaryLines, Path="0", MaintainPaths=True)
branch_9 = TreeBranch(Tree=truss_3.BraceLines, Path=subtraction_6, MaintainPaths=True)
branch_10 = TreeBranch(Tree=truss_3.BraceLines, Path="0", MaintainPaths=True)
branch_11 = TreeBranch(Tree=truss_3.VerticalLines, Path=subtraction_7, MaintainPaths=True)
branch_12 = TreeBranch(Tree=truss_3.VerticalLines, Path=series_29, MaintainPaths=True)
branch_13 = TreeBranch(Tree=truss_3.BraceLines, Path=subtraction_8, MaintainPaths=True)
branch_14 = TreeBranch(Tree=truss_3.BraceLines, Path="0", MaintainPaths=True)
dispatch_5 = Dispatch(List=branch_8, DispatchPattern=[False, True])  # -> ListA, ListB
dispatch_6 = Dispatch(List=branch_7, DispatchPattern=[False, True])  # -> ListA, ListB
ferde_rácsrudak_4 = Line(branch_10)
ferde_rácsrudak_5 = Line(branch_9)
cull_i_8 = CullIndex(List=branch_11, Indices=["0", "-1"], Wrap=True)
cull_i_9 = CullIndex(List=branch_12, Indices="0", Wrap=True)
cull_i_10 = CullIndex(List=branch_13, Indices="-1", Wrap=True)
cull_i_11 = CullIndex(List=branch_14, Indices="0", Wrap=True)
felső_öv_5 = Line(dispatch_5.ListA)
felső_öv_6 = Line(dispatch_6.ListA)
cull_i_12 = CullIndex(List=ferde_rácsrudak_4, Indices="0", Wrap=True)
item_42 = ListItem(List=ferde_rácsrudak_4, Index="0", Wrap=True)
cull_i_13 = CullIndex(List=ferde_rácsrudak_5, Indices="-1", Wrap=True)
item_43 = ListItem(List=ferde_rácsrudak_5, Index="-1", Wrap=True)
lng_21 = ListLength(List=felső_öv_5)  # -> expr("x-1", Length)
lng_22 = ListLength(List=felső_öv_6)  # -> expr("x-1", Length)
lng_23 = ListLength(List=felső_öv_6)
series_30 = Series(Start=0, Step=lng_21, Count=2)
series_31 = Series(Start=0, Step=lng_22, Count=2)
replace_4 = ReplaceItems(List=felső_öv_6, Item=item_43, Indices=expr("x-1", lng_23), Wrap=False)
replace_5 = ReplaceItems(List=felső_öv_5, Item=item_42, Indices="0", Wrap=False)
felső_öv_7 = Line(replace_5)
alsó_öv_4 = Line(dispatch_5.ListB)
felső_öv_8 = Line(replace_4)
alsó_öv_5 = Line(dispatch_6.ListB)
merge_2 = Merge(Data1=felső_öv_8, Data2=alsó_öv_5)  # -> flatten(Result)
merge_3 = Merge(Data1=felső_öv_7, Data2=alsó_öv_4)  # -> flatten(Result)
entwine_9 = Entwine(Branch00=cull_i_11, Branch01=cull_i_10, FlattenInputs=True)  # -> simplify(Result)
crv_5 = Curve(truss_3.BraceLines)
entwine_10 = Entwine(Branch00=cull_i_9, Branch01=cull_i_8, FlattenInputs=True)  # -> simplify(Result)
crv_6 = Curve(truss_3.VerticalLines)
entwine_11 = Entwine(Branch00=merge_3, Branch01=merge_2, FlattenInputs=True)  # -> simplify(Result)
tstat_4 = TreeStatistics(Tree=entwine_10)  # -> Paths, Length, Count
tstat_5 = TreeStatistics(Tree=entwine_9)  # -> Paths, Length, Count
viewer = ParamViewer(entwine_10)
viewer_2 = ParamViewer(entwine_9)
tstat_6 = TreeStatistics(Tree=truss_3.VerticalLines)  # -> Paths, Length, Count
tstat_7 = TreeStatistics(Tree=truss_3.PrimaryLines)  # -> Paths, Length, Count
crv_7 = Curve(truss_3.PrimaryLines)
tstat_8 = TreeStatistics(Tree=entwine_11)  # -> Paths, Length, Count
viewer_3 = ParamViewer(entwine_11)
subtraction_9 = Subtraction(A=tstat_6.Count, B=1)
path_5 = ConstructPath(Indices=graft(["0", subtraction_9]))  # -> simplify(Branch)
split = SplitTree(Data=simplify(crv_6), Masks=flatten(path_5))  # -> Positive, Negative
subtraction_10 = Subtraction(A=tstat_7.Count, B=1)
path_6 = ConstructPath(Indices=graft(["0", subtraction_10]))  # -> simplify(Branch)
split_2 = SplitTree(Data=simplify(crv_5), Masks=flatten(path_6))  # -> Positive, Negative
tstat_9 = TreeStatistics(Tree=truss_3.PrimaryLines)  # -> Paths, Length, Count
viewer_4 = ParamViewer(split.Positive)
subtraction_11 = Subtraction(A=tstat_9.Count, B=1)
path_7 = ConstructPath(Indices=graft(["0", subtraction_11]))  # -> simplify(Branch)
split_3 = SplitTree(Data=simplify(crv_7), Masks=flatten(path_7))  # -> Positive, Negative
viewer_5 = ParamViewer(split_2.Positive)
replace_6 = ReplacePaths(Data=entwine_10, Search=viewer, Replace=viewer_4)
replace_7 = ReplacePaths(Data=entwine_9, Search=viewer_2, Replace=viewer_5)
viewer_6 = ParamViewer(split_3.Positive)
replace_8 = ReplacePaths(Data=entwine_11, Search=viewer_3, Replace=viewer_6)
merge_4 = Merge(Data1=cull_i_9, Data2=cull_i_8)  # -> flatten(Result)
merge_5 = Merge(Data1=split_2.Negative, Data2=replace_7)  # -> flatten(Result)
merge_6 = Merge(Data1=split_3.Negative, Data2=replace_8)  # -> flatten(Result)
dispatch_7 = Dispatch(List=merge_6, DispatchPattern=[False, True])  # -> ListA, ListB
series_32 = Series(Start=0, Step=keretállás_távolság, Count=keretállások_száma)
Y_3 = UnitY(Factor=series_32)  # -> graft(UnitVector)
move_10 = Move(Geometry=merge_4, Motion=Y_3)  # -> Geometry, Transform
move_11 = Move(Geometry=merge_6, Motion=Y_3)  # -> Geometry, Transform
move_12 = Move(Geometry=merge_5, Motion=Y_3)  # -> Geometry, Transform

# ----
# Szögletes szelemenek
szel_felső_öv_kezdőpont = Point(crv_cp.Point)
szel_alsó_öv_kezdőpont = Point(crv_cp_2.Point)
cp = ClosestPoint(Point=szel_felső_öv_kezdőpont, Cloud=flatten(truss_3.StructureNodes))  # -> ClosestPoint, CPIndex, Distance
cp_2 = ClosestPoint(Point=szel_alsó_öv_kezdőpont, Cloud=flatten(truss_3.StructureNodes))  # -> ClosestPoint, CPIndex, Distance
szelemen_felső_övek = Line(item_11)
pt_2 = Point(cp.ClosestPoint)
pt_3 = Point(cp_2.ClosestPoint)
szelemen_alsó_övek = Line(item_10)
vec2pt = Vector2Pt(PointA=szel_felső_öv_kezdőpont, PointB=pt_2, Unitize=False)  # -> Vector, Length
vec2pt_2 = Vector2Pt(PointA=szel_alsó_öv_kezdőpont, PointB=pt_3, Unitize=False)  # -> Vector, Length
move_13 = Move(Geometry=szelemen_felső_övek, Motion=vec2pt.Vector)  # -> simplify(Geometry), Transform
move_14 = Move(Geometry=szelemen_alsó_övek, Motion=vec2pt_2.Vector)  # -> simplify(Geometry), Transform
panel_17 = Panel(szelemen_szegmensek_száma)
truss_4 = _2DTruss(CurveA=move_13.Geometry, CurveB=move_14.Geometry, Divisions=panel_17, TrussToggle=0)  # -> PrimaryLines, BraceLines, VerticalLines, StructureNodes
end_8 = EndPoints(Curve=move_13.Geometry)  # -> Start, End
series_33 = Series(Start=0, Step=-1, Count=2)
pt_4 = Point(end_8.End)
cull_i_14 = CullIndex(List=truss_4.VerticalLines, Indices=series_33, Wrap=True)
item_44 = ListItem(List=truss_4.VerticalLines, Index=series_33, Wrap=True)
szelemen_övek_3 = Line(truss_4.PrimaryLines)
szelemen_ferde_rácsrudak_4 = Line(truss_4.BraceLines)
szelemen_függőleges_rácsrudak_2 = Line(simplify(cull_i_14))

# ----
# Merevítések
panel_18 = Panel(_1_merevítés_pozíciója)
panel_19 = Panel(_2_merevítés_pozíciója)
panel_20 = Panel(_4_merevítés_pozíciója)
panel_21 = Panel(list)
panel_22 = Panel(_3_merevítés_pozíciója)
panel_23 = Panel(merevítések_száma)
num = Number(entwine)
series_34 = Series(Start=0, Step=1, Count=panel_23)
merge_7 = Merge(Data1=panel_18, Data2=panel_19, Data3=panel_22, Data4=panel_20)
lng_24 = ListLength(List=num)
series_35 = Series(Start=0, Step=1, Count=lng_24)
item_45 = ListItem(List=merge_7, Index=series_34, Wrap=True)  # -> graft(Item)
end_9 = EndPoints(Curve=move_13.Geometry)  # -> Start, End
item_46 = TreeItem(Tree=end_9.End, Path=item_45, Index=series_35, Wrap=True)  # -> simplify(Element)
item_47 = TreeItem(Tree=end_9.Start, Path=item_45, Index=series_35, Wrap=True)  # -> simplify(Element)
shift_3 = ShiftList(List=item_47, Shift=1, Wrap=True)
shift_4 = ShiftList(List=item_46, Shift=1, Wrap=True)
ln_5 = Line(StartPoint=item_46, EndPoint=shift_3)
ln_6 = Line(StartPoint=item_47, EndPoint=shift_4)
cull_i_15 = CullIndex(List=ln_5, Indices="-1", Wrap=True)
cull_i_16 = CullIndex(List=ln_6, Indices="-1", Wrap=True)
dispatch_8 = Dispatch(List=cull_i_15, DispatchPattern=[True, False])  # -> ListA, ListB
dispatch_9 = Dispatch(List=cull_i_16, DispatchPattern=[True, False])  # -> ListA, ListB
line_14 = Line(dispatch_9.ListA)
line_15 = Line(dispatch_9.ListB)
line_16 = Line(dispatch_8.ListA)
line_17 = Line(dispatch_8.ListB)
line_18 = Line(simplify([line_14, line_17]))
line_19 = Line(simplify([line_15, line_16]))
line_20 = Line(simplify([line_14, line_15, line_16, line_17]))
entwine_12 = Entwine(Branch00=line_18, Branch01=line_19, Branch02=line_20, FlattenInputs=True)  # -> simplify(Result)
branch_15 = TreeBranch(Tree=entwine_12, Path=panel_21, MaintainPaths=True)

# ----
# Teljes szerkezet
keret_övek = Line(move_11.Geometry)
ferde_rácsrudak_6 = Line(move_12.Geometry)
normál_irányú_rácsrudak_4 = Line(move_10.Geometry)
szelemen_övek_4 = Line(szelemen_övek_3)
szelemen_normál_irányú_rácsrudak_2 = Line(szelemen_függőleges_rácsrudak_2)
merevítés_2 = Line(branch_15)
szelemen_ferde_rácsrudak_5 = Line(szelemen_ferde_rácsrudak_4)

# ----
# Teljes szerkezet
ferde_rácsrudak_7 = Line(move_12.Geometry)
normál_irányú_rácsrudak_5 = Line(move_10.Geometry)
szelemen_felső_övek_2 = Line(move_13.Geometry)
szelemen_alsó_övek_2 = Line(move_14.Geometry)
szelemen_ferde_rácsrudak_6 = Line(szelemen_ferde_rácsrudak_4)
szelemen_normál_irányú_rácsrudak_3 = Line(szelemen_függőleges_rácsrudak_2)
merevítés_3 = Line(branch_15)
keret_övek_2 = Line(move_11.Geometry)

keret_övek_3 = Line(simplify(keret_övek_2))
ferde_rácsrudak_8 = Line(simplify(ferde_rácsrudak_7))
normál_irányú_rácsrudak_6 = Line(simplify(normál_irányú_rácsrudak_5))
szelemen_felső_övek_3 = Curve(szelemen_felső_övek_2)
szelemen_alsó_övek_3 = Curve(szelemen_alsó_övek_2)
szelemen_ferde_rácsrudak_7 = Curve(szelemen_ferde_rácsrudak_6)
szelemen_rácsrúdal_elforg_szög = Number(expression_2)
series_36 = Series(Start=0, Step=0, Count=11)  # -> graft(Series)
series_37 = Series(Start=0, Step=1, Count=11)  # -> graft(Series)
num_2 = Number(szelemen_rácsrúdal_elforg_szög)
num_3 = Number(szelemen_rácsrúdal_elforg_szög)
num_4 = Number(szelemen_rácsrúdal_elforg_szög)
num_5 = Number(szelemen_rácsrúdal_elforg_szög)
num_6 = Number(szelemen_rácsrúdal_elforg_szög)
num_7 = Number(szelemen_rácsrúdal_elforg_szög)
flatten = FlattenTree(Tree=num_2, Path="{5}")
flatten_2 = FlattenTree(Tree=num_3, Path="{0}")
flatten_3 = FlattenTree(Tree=num_4, Path="{1}")
flatten_4 = FlattenTree(Tree=num_5, Path="{2}")
flatten_5 = FlattenTree(Tree=num_6, Path="{3}")
flatten_6 = FlattenTree(Tree=num_7, Path="{4}")
data = Data([flatten_2, flatten_3, flatten_4, flatten_5, flatten_6, flatten])
path_8 = ConstructPath(Indices=0)
path_9 = ConstructPath(Indices=0)
path_10 = ConstructPath(Indices=[series_36, series_37])
num_8 = Number(simplify(graft(expression_2)))
num_9 = Number(simplify(graft(expression_4)))
flip_15 = FlipMatrix(Data=data)
branch_16 = TreeBranch(Tree=keret_övek_3, Path=["{0}", "{1}"], MaintainPaths=True)
P = ProfileCatalog(Profile="SHS200*16")
pos = Position(Plane=0, Rotation=0, Depth=0, Position="Center, Mid")
branch_17 = TreeBranch(Tree=ferde_rácsrudak_8, Path=["{0}", "{1}"], MaintainPaths=True)
P_2 = ProfileCatalog(Profile="RHS90*50*6.3")
pos_2 = Position(Plane=0, Rotation=90, Depth=0, Position="Center, Mid")
branch_18 = TreeBranch(Tree=normál_irányú_rácsrudak_6, Path=["{0}", "{1}"], MaintainPaths=True)
P_3 = ProfileCatalog(Profile="RHS50*30*4")
pos_3 = Position(Plane=0, Rotation=90, Depth=0, Position="Center, Mid")
branch_19 = TreeBranch(Tree=szelemen_felső_övek_3, Path=path_8, MaintainPaths=True)
P_4 = ProfileCatalog(Profile="RHS250*150*12.5")
pos_4 = Position(Plane=0, Rotation=num_8, Depth=0, Position="Center, Mid")
branch_20 = TreeBranch(Tree=szelemen_alsó_övek_3, Path=path_9, MaintainPaths=True)
P_5 = ProfileCatalog(Profile="RHS250*150*12.5")
pos_5 = Position(Plane=0, Rotation=num_9, Depth=0, Position="Center, Mid")
branch_21 = TreeBranch(Tree=szelemen_ferde_rácsrudak_7, Path=path_10, MaintainPaths=True)
P_6 = ProfileCatalog(Profile="RHS90*50*5")
pos_6 = Position(Plane=0, Rotation=flip_15, Depth=0, Position="Center, Mid")
beam = Beam(Curve=branch_16, Profile=P, Position=pos, Remove_while_inputs_are_being_modified=False, Run_in_background=True)
beam_2 = Beam(Curve=branch_17, Profile=P_2, Position=pos_2, Remove_while_inputs_are_being_modified=False, Run_in_background=True)
beam_3 = Beam(Curve=branch_18, Profile=P_3, Position=pos_3, Remove_while_inputs_are_being_modified=False, Run_in_background=True)
beam_4 = Beam(Curve=branch_19, Profile=P_4, Position=pos_4, Remove_while_inputs_are_being_modified=False, Run_in_background=True)
beam_5 = Beam(Curve=branch_20, Profile=P_5, Position=pos_5, Remove_while_inputs_are_being_modified=False, Run_in_background=True)
beam_6 = Beam(Curve=branch_21, Profile=P_6, Position=pos_6, Remove_while_inputs_are_being_modified=False, Run_in_background=True)

# ----
# Exportálás Axisba
panel_24 = Panel("Övek")
axmembers_8 = AxMembersAxisVM(Line=keret_övek, Name=panel_24, Mat="S 235", CrossSection="250X100X 6,0", Type="beam")  # -> flatten(AxMember)
axmembers_9 = AxMembersAxisVM(Line=ferde_rácsrudak_6, Name="Ferde rácsrudak", Mat="S 235", CrossSection="50X 30X 3,0", Type="truss")  # -> flatten(AxMember)
axmembers_10 = AxMembersAxisVM(Line=normál_irányú_rácsrudak_4, Name="Normál irányú rácsrudak", Mat="S 235", CrossSection="50X 30X 4,0", Type="truss")  # -> flatten(AxMember)
axmembers_11 = AxMembersAxisVM(Line=szelemen_övek_4, Name="Szelemen övek", Mat="S 235", CrossSection="80X 40X 4,0", Type="beam")  # -> flatten(AxMember)
axmembers_12 = AxMembersAxisVM(Line=szelemen_ferde_rácsrudak_5, Name="Szelemen ferde rácsrudak", Mat="S 235", CrossSection="50X 30X 2,5", Type="truss")  # -> flatten(AxMember)
axmembers_13 = AxMembersAxisVM(
    Line=szelemen_normál_irányú_rácsrudak_2,
    Name="Szelemen normál irányú rácsrudak",
    Mat="S 235",
    CrossSection="50X 30X 3,2",
    Type="truss")  # -> flatten(AxMember)
axmembers_14 = AxMembersAxisVM(Line=merevítés_2, Name="Merevítés", Mat="S 235", CrossSection="O 40", Type="truss")  # -> flatten(AxMember)
entwine_13 = Entwine(
    Branch00=axmembers_8,
    Branch01=axmembers_9,
    Branch02=axmembers_10,
    Branch03=axmembers_11,
    Branch04=[axmembers_12, axmembers_13],
    Branch05=axmembers_14,
    FlattenInputs=True)  # -> flatten(Result)
axmember_2 = AxMemberParameter(entwine_13)
membtoaxisvm_2 = SendMembersToAxisVM(AxisVMMember=axmember_2)

# ----
# Mennyiségek tömegpontok értékeinek számításához
line_21 = Line(felső_öv_7)
line_22 = Line(felső_öv_8)
line_23 = Line(truss_3.PrimaryLines)
dispatch_10 = Dispatch(List=line_23, DispatchPattern=[False, True])  # -> ListA, ListB
series_38 = Series(Start=0, Step=-1, Count=2)  # -> graft(Series)
line_24 = Line(flatten(dispatch_10.ListA))
lng_25 = ListLength(List=line_24)
subtraction_12 = Subtraction(A=lng_25, B=1)
item_48 = ListItem(List=[line_21, line_22], Index=series_38, Wrap=True)  # -> flatten(Item)
series_39 = Series(Start=0, Step=subtraction_12, Count=2)  # -> flatten(Series)
branch_22 = TreeBranch(Tree=simplify(ferde_rácsrudak_6), Path="0", MaintainPaths=True)
branch_23 = TreeBranch(Tree=simplify(normál_irányú_rácsrudak_4), Path="0", MaintainPaths=True)
replace_9 = ReplaceItems(List=line_24, Item=item_48, Indices=series_39, Wrap=False)
join_5 = JoinCurves(Curves=replace_9, Preserve=False)
szelemen_övek_hossza_2 = Integer(expr("x*2", keretállás_távolság))
keret_normál_rácsrudak_2 = Line(flatten(branch_23))
keret_ferde_rácsrudak_2 = Line(flatten(branch_22))
szelemen_normál_rácsrudak_2 = Line(szelemen_normál_irányú_rácsrudak_2)
szelemen_ferde_rácsrudak_8 = Line(szelemen_ferde_rácsrudak_5)
felső_öv_9 = Curve(join_5)
alsó_öv_6 = Line(alsó_öv)
merevítések_2 = Line(merevítés_2)
multiplication_11 = Multiplication(A=keretállás_távolság, B=keretállások_száma)
Y_4 = UnitY(Factor=multiplication_11)
len_9 = Length(Curve=flatten(szelemen_ferde_rácsrudak_8))
len_10 = Length(Curve=flatten(szelemen_normál_rácsrudak_2))
len_11 = Length(Curve=keret_ferde_rácsrudak_2)
len_12 = Length(Curve=keret_normál_rácsrudak_2)
len_13 = Length(Curve=felső_öv_9)
len_14 = Length(Curve=alsó_öv_6)
len_15 = Length(Curve=merevítések_2)
move_15 = Move(Geometry=replace_9, Motion=Y_4)  # -> Geometry, Transform
ma_8 = MassAddition(Input=len_11)  # -> Result, PartialResults
lng_26 = ListLength(List=len_11)
lng_27 = ListLength(List=keret_ferde_rácsrudak_2)
ma_9 = MassAddition(Input=len_12)  # -> Result, PartialResults
lng_28 = ListLength(List=len_12)
lng_29 = ListLength(List=keret_normál_rácsrudak_2)
ma_10 = MassAddition(Input=len_13)  # -> Result, PartialResults
ma_11 = MassAddition(Input=len_14)  # -> Result, PartialResults
ma_12 = MassAddition(Input=len_15)  # -> Result, PartialResults
ma_13 = MassAddition(Input=len_9)  # -> Result, PartialResults
lng_30 = ListLength(List=len_9)
ma_14 = MassAddition(Input=len_10)  # -> Result, PartialResults
lng_31 = ListLength(List=len_10)
lng_32 = ListLength(List=entwine)
szelemen_szegmensek_száma_4 = Integer(szelemen_szegmensek_száma)
keretállás_távolság_4 = Integer(keretállás_távolság)
keretállások_száma_5 = Integer(keretállások_száma)
division_9 = Division(A=ma_8.Result, B=lng_26)
division_10 = Division(A=ma_9.Result, B=lng_28)
division_11 = Division(A=ma_13.Result, B=lng_30)
division_12 = Division(A=ma_14.Result, B=lng_31)
join_6 = JoinCurves(Curves=replace_9, Preserve=False)
join_7 = JoinCurves(Curves=move_15.Geometry, Preserve=False)
subtraction_13 = Subtraction(A=szelemen_szegmensek_száma_4, B=1)
szelemen_szegmensek_száma_5 = Panel(szelemen_szegmensek_száma_4)
szelemenek_száma_2 = Panel(lng_32)
ferde_rácsrudak_átlagos_hossza_2 = Panel(division_9)
ferde_rácsrudak_száma_2 = Panel(lng_27)
normál_rácsrudak_átlagos_hossza_2 = Panel(division_10)
normál_rácsrudak_száma_2 = Panel(lng_29)
felső_öv_hossza_2 = Panel(ma_10.Result)
alsó_öv_hossza_2 = Panel(ma_11.Result)
szelemen_alsó_felső_övhossza_2 = Panel(szelemen_övek_hossza_2)
keretállás_távolság_5 = Panel(keretállás_távolság_4)
keretállások_száma_6 = Panel(keretállások_száma_5)
multiplication_12 = Multiplication(A=division_11, B=szelemen_szegmensek_száma_4)
multiplication_13 = Multiplication(A=division_12, B=subtraction_13)
rulesrf_2 = RuledSurface(CurveA=join_6, CurveB=join_7)
addition_4 = Addition(A=felső_öv_hossza_2, B=alsó_öv_hossza_2)
szelemen_ferde_rácsrudak_átlagos_hossza_2 = Panel(multiplication_12)  # "Szelemen ferde rácsrudak átlagos hossza (szelemenenként)"
szelemen_normál_rácsrudak_átlagos_hossza_2 = Panel(multiplication_13)  # "Szelemen normál rácsrudak átlagos hossza (szelemenenként)"
area_2 = Area(Geometry=rulesrf_2)  # -> Area, Centroid
subtraction_14 = Subtraction(A=szelemenek_száma_2, B=1)
ferde_rácsrudak_átl_száma_2_szelemen_köz_2 = Division(A=ferde_rácsrudak_száma_2, B=subtraction_14)  # "Ferde rácsrudak átl. száma 2 szelemen közt"
normál_rácsrudak_átl_száma_2_szelemen_kö_3 = Division(A=normál_rácsrudak_száma_2, B=subtraction_14)  # "Normál rácsrudak átl. száma 2 szelemen közt"
normál_rácsrudak_átl_száma_2_szelemen_kö_4 = Division(A=addition_4, B=subtraction_14)  # "Normál rácsrudak átl. száma 2 szelemen közt"
szelemenek_közti_szegmensek_száma_2 = Panel(subtraction_14)
lefedés_területe_2 = Panel(area_2.Area)
multiplication_14 = Multiplication(A=ferde_rácsrudak_átlagos_hossza_2, B=ferde_rácsrudak_átl_száma_2_szelemen_köz_2)
multiplication_15 = Multiplication(A=normál_rácsrudak_átlagos_hossza_2, B=normál_rácsrudak_átl_száma_2_szelemen_kö_3)
_2_szelemen_közé_eső_ferde_rácsrudak_átl_2 = Panel(multiplication_14)  # "2 szelemen közé eső ferde rácsrudak átl. szum. hossza"
_2_szelemen_közé_eső_övek_szum_hossza_2 = Panel(normál_rácsrudak_átl_száma_2_szelemen_kö_4)
_2_szelemen_közé_eső_normál_rácsrudak_át_2 = Panel(multiplication_15)  # "2 szelemen közé eső normál rácsrudak átl. szum. hossza"
merevítések_össz_hossza_2 = Panel(ma_12.Result)
entwine_14 = Entwine(
    Branch00=_2_szelemen_közé_eső_ferde_rácsrudak_átl_2,
    Branch01=_2_szelemen_közé_eső_normál_rácsrudak_át_2,
    Branch02=_2_szelemen_közé_eső_övek_szum_hossza_2,
    Branch03=merevítések_össz_hossza_2,
    Branch04=szelemen_alsó_felső_övhossza_2,
    Branch05=szelemen_ferde_rácsrudak_átlagos_hossza_2,
    Branch06=szelemen_normál_rácsrudak_átlagos_hossza_2,
    Branch07=keretállás_távolság_5,
    Branch08=keretállások_száma_6,
    Branch09=szelemen_szegmensek_száma_5,
    Branch010=szelemenek_száma_2,
    Branch011=lefedés_területe_2,
    FlattenInputs=True)  # -> flatten(Result)
d_stbedudrive_onedrive_budapesti_műszaki_2 = FilePath("D:\stbedudrive\OneDrive - Budapesti Műszaki és Gazdaságtudományi Egyetem\Egyetem\14_szakdolgozat\Grasshopper\szogletes\tomegpontok.xlsx")  # "d:\stbedudrive\OneDrive - Budapesti Műszaki és Gazdaságtudományi Egyetem\Egyetem\14_szakdolgozat\Grasshopper\tomegpontok.xlsx"
panel_25 = Panel(entwine_14)
excelwrite_2 = ExcelWrite(
    WriteExcelData=Button(),
    WorkbookPath=d_stbedudrive_onedrive_budapesti_műszaki_2,
    WorksheetName="GH_adatok",
    ColumnHeadings="Grasshopper adatok",
    Data=entwine_14,
    ClearSheet=False)
